# Grasshopper definition vtown.gh (Grasshopper 1.0.7)

voronoi_resolution = Slider(1000, range=0..2000)
size = Slider(100, range=0..100)
curvepoint1 = Slider(0.413, range=0..1)
curvepoint2 = Slider(0.811, range=0..1)
curvepoint3 = Slider(0.273, range=0..1)
curvepoint4 = Slider(0.476, range=0..1)
merge = Merge(Data1=curvepoint1, Data2=curvepoint2, Data3=curvepoint3, Data4=curvepoint4)
num = Number(size)
planesrf = PlaneSurface(Plane=PlaneXY(0, 0, 0), XSize=num, YSize=num)
num_2 = Number(voronoi_resolution)
range = Range(Domain=num, Steps="3")
multiplication = Multiplication(A=merge, B=num)
maxattractionpowerratio = Slider(0.24, range=0..1)
curveattractiondistance = Slider(16.7, range=0..100)
minattractionpowerratio = Slider(0.46, range=0..1)
popgeo = PopulateGeometry(Geometry=planesrf, Count=num_2, Seed=1)
pt = ConstructPoint(XCoordinate=range, YCoordinate=multiplication, ZCoordinate=0)
intcrv = Interpolate(Vertices=pt, Degree=3, Periodic=False, KnotStyle=1)  # -> Curve, Length, Domain
crv_cp = CurveClosestPoint(Point=popgeo, Curve=intcrv.Curve)  # -> Point, Parameter, Distance
num_3 = Number(minattractionpowerratio)
num_4 = Number(maxattractionpowerratio)
dom = ConstructDomain(DomainStart=num_3, DomainEnd=num_4)
min = Minimum(A=crv_cp.Distance, B=curveattractiondistance)
bnd = Bounds(Numbers=min)
lng = ListLength(List=crv_cp.Distance)
remap = RemapNumbers(Value=min, Source=bnd, Target=dom)  # -> Mapped, Clipped
minheight = Slider(2.8, range=0..10)
maxheight = Slider(54, range=0..100)
color_hue = Slider(0.33, range=0..1)
random = Random(Range=Domain(0, 1), Number=lng, Seed=2)
smaller = SmallerThan(FirstNumber=random, SecondNumber=remap.Clipped)  # -> SmallerThan, OrEqualTo
geo = Geometry(planesrf)
cull = CullPattern(List=popgeo, CullPattern=smaller.SmallerThan)
num_5 = Number(minheight)
num_6 = Number(maxheight)
dom_2 = ConstructDomain(DomainStart=num_5, DomainEnd=num_6)
voronoi = Voronoi(Points=cull, Boundary=geo, BruteForceOverride=False)
area = Area(Geometry=voronoi)  # -> Area, Centroid
num_7 = Number(area.Area)
bnd_2 = Bounds(Numbers=num_7)
remap_2 = RemapNumbers(Value=num_7, Source=bnd_2, Target=dom_2)  # -> Mapped, Clipped
num_8 = Number(num_7)
boundary = BoundarySurfaces(Edges=voronoi)
Z = UnitZ(Factor=remap_2.Mapped)
bnd_3 = Bounds(Numbers=num_8)
dom_3 = ConstructDomain(DomainStart="0.2", DomainEnd="0.4")
extr = Extrude(Base=boundary, Direction=Z)
remap_3 = RemapNumbers(Value=num_8, Source=bnd_3, Target=dom_3)  # -> Mapped, Clipped
hsl = ColourHSL(Alpha=1, Hue=color_hue, Saturation=1, Luminance=remap_3.Mapped)
mesh = MeshBrep(
    Brep=extr,
    Settings={GridMaxCount=0, GridMinCount=16, JaggedSeams=False, MaxEdgeLength=0, MinEdgeLength=0.0001, MinTolerance=0, Refine=True, RefineAngle=0, RelativeTolerance=0.65, SimplePlanes=True, Tolerance=0})
mesh_2 = Mesh(mesh)
preview = CustomPreview(Geometry=mesh_2, Material=hsl)
